# Dynamo graph parametric_structure.dyn "Red_Nueva" (Dynamo 2.18.1.5096)

T_Palillo = DoubleSlider(12, range=0..100 step 0.1)
ancho = IntegerSlider(7, range=0..100 step 1)
largo = IntegerSlider(5, range=0..100 step 1)
niveles = IntegerSlider(1, range=1..4 step 1)
grosor = DoubleSlider(0.5, range=0.5..2.5 step 0.1)
flip = IntegerSlider(0, range=0..1 step 1)
diagonales = IntegerSlider(1, range=0..1 step 1)
number_slider = DoubleSlider(8.4, range=0..150 step 0.1)
columnas_X = IntegerSlider(8, range=2..10 step 1)
columnas_Y = IntegerSlider(7, range=2..10 step 1)
python_script = Python(IN[0]=T_Palillo, IN[1]=ancho, IN[2]=largo, IN[3]=niveles, IN[4]=grosor, IN[5]=flip, IN[6]=diagonales, IN[7]=number_slider, IN[8]=columnas_X, IN[9]=columnas_Y)  # CPython3
# ---------- python_script.python (126 lines) ----------
import clr
clr.AddReference('ProtoGeometry')
from Autodesk.DesignScript.Geometry import Point, Line
import math

# 1. Variables de Sliders
L               = float(IN[0])
U               = int(IN[1])
V               = int(IN[2])
num_niveles     = max(1, int(IN[3]))
factor_grosor   = float(IN[4])
flip            = int(IN[5])
diag_cruzadas   = int(IN[6])
H_columna       = float(IN[7]) # Nuevo: Altura de columnas
num_cols_u      = int(IN[8]) # NUEVO: Apoyos en X
num_cols_v      = int(IN[9]) # NUEVO: Apoyos en Y

direccion_z = -1.0 if flip == 1 else 1.0
H_base = L * (math.sqrt(2.0) / 2.0) * factor_grosor

# 2. Generación de mallas
mallas_puntos = []
for k in range(num_niveles + 1):
    z_actual = k * H_base * direccion_z
    capa_k = []
    if k % 2 == 0:
        for i in range(U + 1):
            fila = []
            for j in range(V + 1):
                fila.append(Point.ByCoordinates(i * L, j * L, z_actual))
            capa_k.append(fila)
    else:
        for i in range(U):
            fila = []
            for j in range(V):
                fila.append(Point.ByCoordinates((i * L) + (L / 2.0), (j * L) + (L / 2.0), z_actual))
            capa_k.append(fila)
    mallas_puntos.append(capa_k)

# 3. Clasificación de Armadura
cuerdas_inferiores, cuerdas_superiores, cuerdas_intermedias = [], [], []
diagonales_espacio, diagonales_planas = [], []

for k in range(num_niveles + 1):
    pts = mallas_puntos[k]
    filas, columnas = len(pts), len(pts[0])
    barras_capa = []
    for i in range(filas - 1):
        for j in range(columnas): barras_capa.append(Line.ByStartPointEndPoint(pts[i][j], pts[i+1][j]))
    for i in range(filas):
        for j in range(columnas - 1): barras_capa.append(Line.ByStartPointEndPoint(pts[i][j], pts[i][j+1]))
    if diag_cruzadas == 1:
        for i in range(filas - 1):
            for j in range(columnas - 1):
                diagonales_planas.append(Line.ByStartPointEndPoint(pts[i][j], pts[i+1][j+1]))
                diagonales_planas.append(Line.ByStartPointEndPoint(pts[i+1][j], pts[i][j+1]))
    
    if k == 0: cuerdas_inferiores.extend(barras_capa)
    elif k == num_niveles: cuerdas_superiores.extend(barras_capa)
    else: cuerdas_intermedias.extend(barras_capa)

for k in range(num_niveles):
    pts_inf, pts_sup = mallas_puntos[k], mallas_puntos[k + 1]
    if k % 2 == 0:
        for i in range(U):
            for j in range(V):
                cima = pts_sup[i][j]
                for x, y in [(0,0), (1,0), (0,1), (1,1)]: diagonales_espacio.append(Line.ByStartPointEndPoint(cima, pts_inf[i+x][j+y]))
    else:
        for i in range(U):
            for j in range(V):
                base = pts_inf[i][j]
                for x, y in [(0,0), (1,0), (0,1), (1,1)]: diagonales_espacio.append(Line.ByStartPointEndPoint(base, pts_sup[i+x][j+y]))

# 4. Generación de Apoyos (Distribución paramétrica)
ejes_columnas = []
puntos_cimentacion = []

# 1. Asegurar la lectura de los Sliders
try:
    num_cols_u = int(IN[8])
    num_cols_v = int(IN[9])
except:
    # Si por alguna razón los sliders fallan, asignamos 3 para forzar una columna central
    num_cols_u = 3 
    num_cols_v = 3

# Garantizar que al menos existan 2 columnas por eje
num_cols_u = max(2, num_cols_u)
num_cols_v = max(2, num_cols_v)

# 2. CÁLCULO CORREGIDO: Se añade 'float()' para evitar el error de división entera de Python
indices_u = [int(round(i * U / float(num_cols_u - 1))) for i in range(num_cols_u)]
indices_v = [int(round(i * V / float(num_cols_v - 1))) for i in range(num_cols_v)]

# Guardar las coordenadas (i, j)
apoyos_indices = []

for i in indices_u:
    for j in indices_v:
        apoyos_indices.append((i, j))

# 3. Generar la geometría de columnas y zapatas
for i, j in apoyos_indices:
    i_seguro = min(int(i), U)
    j_seguro = min(int(j), V)
    
    try:
        # Intento A: La matriz está estructurada como [X][Y]
        p_base = mallas_puntos[0][i_seguro][j_seguro]
    except:
        # Intento B: Si la matriz fue generada como [Y][X] por Dynamo
        p_base = mallas_puntos[0][j_seguro][i_seguro]
        
    # Calcular el punto en el suelo restando la altura de la columna
    p_suelo = Point.ByCoordinates(p_base.X, p_base.Y, p_base.Z - H_columna)
    
    puntos_cimentacion.append(p_suelo)
    ejes_columnas.append(Line.ByStartPointEndPoint(p_suelo, p_base))

# 5. Salida unificada con 7 puertos
OUT = [
    cuerdas_inferiores, cuerdas_superiores, cuerdas_intermedias, 
    diagonales_espacio, diagonales_planas, 
    ejes_columnas, puntos_cimentacion
]
# ----------------------------------------
code_block = CodeBlock(datos=python_script)
# ---------- code_block.designscript (7 lines) ----------
Cuerda_Inferior = datos[0];
Cuerda_Superior = datos[1];
Cuerdas_Medias = datos[2];
Diagonales_3D = datos[3];
Rigidizaciones_2D = datos[4];
Lineas_Columnas = datos[5];
Puntos_Zapatas = datos[6];
# ----------------------------------------
levels = Levels("Nivel 0")
structural_framing_types = StructuralFramingTypes("HE320A")
beamByCurve = StructuralFraming.BeamByCurve(curve=code_block.Cuerda_Inferior, level=levels, structuralFramingType=structural_framing_types)
family_types = FamilyTypes("Zapata-Rectangular:2400 x 1800 x 450mm")
byPoint = FamilyInstance.ByPoint(familyType=family_types, point=code_block.Puntos_Zapatas)
levels_2 = Levels("Nivel 0")
structural_column_types = StructuralColumnTypes("600 x 750")
columnByCurve = StructuralFraming.ColumnByCurve(curve=code_block.Lineas_Columnas, level=levels_2, structuralColumnType=structural_column_types)
levels_3 = Levels("Nivel 1")
beamByCurve_2 = StructuralFraming.BeamByCurve(curve=code_block.Cuerda_Superior, level=levels_3, structuralFramingType=structural_framing_types)
levels_4 = Levels("Nivel 1")
beamByCurve_3 = StructuralFraming.BeamByCurve(curve=code_block.Diagonales_3D, level=levels_4, structuralFramingType=structural_framing_types)
structural_framing_types_2 = StructuralFramingTypes("RB 24")
beamByCurve_4 = StructuralFraming.BeamByCurve(curve=code_block.Rigidizaciones_2D, level=levels, structuralFramingType=structural_framing_types_2)
